% Simulink data dictionary Ctrl_Common_data.sldd

EngTrqMax_K2 = Simulink.Parameter([200 300 350 400 400 400], Min=0, Max=400, Unit="N*m")  % Engine Maximum Torque Curve
EngTrqMax_K2x = Simulink.Parameter([0 500 1000 2000 3000 4000], Min=0, Max=4000, Unit="rpm")  % Engine Maximum Torque Curve BPx Engine speed