% Simulink data dictionary HEV_Ctrl_V1_Local_data.sldd

Accel_pedal = Simulink.Signal(Min=0, Max=100, Unit="%")  % Acceleration pedal position
AstEnblEngSpdMin_H_K = Simulink.Parameter(300, Min=0, Max=500, Unit="rpm")  % HEV Motor Assist Available Engine speed Lower Limit high
AstEnblEngSpdMin_L_K = Simulink.Parameter(200, Min=0, Max=500, Unit="rpm")  % HEV Motor Assist Available Engine speed Lower Limit low
AstEnblSocMin_H_K = Simulink.Parameter(30, Min=0, Max=50, Unit="%")  % HEV Motor Assist Available SOC Lower Limit high
AstEnblSocMin_L_K = Simulink.Parameter(25, Min=0, Max=50, Unit="%")  % HEV Motor Assist Available SOC Lower Limit low
AstEnblVehSpdMin_H_K = 0
AstEnblVehSpdMin_L_K = -1
AstTrqCmpSOC_K2 = [0 0.4 0.8 1 1 1]
AstTrqCmpSOC_X = [10 20 40 60 80 100]

AstTrqDstBase_K3 = [0.8 0.5 0.5 0.3 0.3 0.2
 0.8 0.5 0.5 0.3 0.3 0.2
 0.8 0.4 0.4 0.3 0.3 0.1
 0.8 0.3 0.3 0.3 0.3 0.1
 0.8 0.4 0.4 0.2 0.2 0
 0.8 0.5 0.5 0.1 0.1 0]

AstTrqDstBase_X = [200 500 1000 2000 3000 4000]
AstTrqDstBase_Y = [0 0.2 0.4 0.6 0.8 1]
Brake_pedal = Simulink.Signal(Min=0, Max=100, Unit="%")  % Brake pedal position
DifferentialGearRatio_K = 1.33
DrvReqPropTrqMax_K = Simulink.Parameter(400, Min=0, Max=500, Unit="N*m")  % Driver Request maximum propultion torque

DrvReqPropTrq_K3 = Simulink.Parameter([0 0 0 0 0
 15 0 0 0 0
 30 15 0 0 0
 50 30 15 0 0
 70 50 30 15 0
 90 70 50 35 15
 100 90 70 55 35
 100 100 90 75 55
 100 100 100 90 75
 100 100 100 100 90
 100 100 100 100 100], Min=0, Max=100, Unit="%")  % Driver Demand Torque Table

DrvReqPropTrq_K3x = Simulink.Parameter([500 1000 2000 3000 4000], Min=0, Max=4000, Unit="rpm")  % Driver Demand Torque Table BPx Engine speed
DrvReqPropTrq_K3y = Simulink.Parameter([0 10 20 30 40 50 60 70 80 90 100], Min=0, Max=100, Unit="%")  % Driver Demand Torque Table BPy Accel position
EngTrqMax_K2 = Simulink.Parameter([200 300 350 400 400 400], Min=0, Max=400, Unit="N*m")  % Engine Maximum Torque Curve
EngTrqMax_K2x = Simulink.Parameter([0 500 1000 2000 3000 4000], Min=0, Max=4000, Unit="rpm")  % Engine Maximum Torque Curve BPx Engine speed
EngineSpd = Simulink.Signal(Min=0, Max=5000, Unit="rpm")  % Engine speed
HEV_ECU_Info = Simulink.Signal(DataType="Bus: HEV_ECU_Info_Bus")  % HEV制御情報バス
HevCtrlEnbl_K = Simulink.Parameter(1, Min=0, Max=1)  % HEV Control Enable switch
RchEnblEngSpdMin_H_K = 800
RchEnblEngSpdMin_L_K = 700
RchgEnblSocMax_H_K = 45
RchgEnblSocMax_L_K = 35
RchgTrqCmpSOC_K2 = [1 1 1 0 0 0]
RchgTrqCmpSOC_X = [10 20 40 60 80 100]
RegnBrkCmpSOC_K2 = [1 1 1 1 1 0]
RegnBrkCmpSOC_X = [10 20 40 60 80 90]
RegnBrkEnblBrkPdlMin_H_K = 5
RegnBrkEnblBrkPdlMin_L_K = 1
RegnBrkEnblSocMax_H_K = 95
RegnBrkEnblSocMax_L_K = 90
RegnBrkEnblVehSpdMin_H_K = 5
RegnBrkEnblVehSpdMin_L_K = 1
TransmissionGearPosMax_K = 4
TransmissionGearRatio_K2 = [2.47 1.47 1 0.8]

eHevCtrlMode = enum(DefaultValue="Standby")
  Standby = 0
  Assist = 2
  EngineStart = 3
  RegenBrake = 4
  ReCharge = 5

eIdleStopCtrlMode = enum(DefaultValue="EngineRun")
  IdleStop = 0
  EngineStart = 1
  IdleStopWait = 2
  EngineRun = 4

IdleStopCtrlEnbl_K = true