% Simulink data dictionary HEV_ECU_V1_Global_data.sldd

HEV_ECU_CAN_Bus = Simulink.Bus()  % HEV ECU CAN出力
  Engine_torque_request: double, Unit="N*m"  % HEVエンジン要求トルク
  Motor_torque_request: double, Unit="N*m"  % HEVモーター要求トルク
  Regen_brake_torque_achieved: double, Unit="N*m"  % 回生ブレーキ供給トルク（ホイール）
  Regen_brake_torque_available: double, Unit="N*m"  % 回生ブレーキ供給可能トルク（ホイール）

HEV_ECU_Info_Bus = Simulink.Bus()  % HEV ECU情報
  DrvReqPrpTrq: double, Unit="N*m"  % ドライバー要求前進トルク
  HevCtrlMode: Enum: Hev_CtrlMode  % HEV制御モード