% Simulink data dictionary HEVPlant_Ptbs_V1.sldd

DiffRatio = 3.421
EV_current = 200
EV_motion = [20 4 0.8]
EV_sf = 2000
EngDriveRatio = 0.8130081
Fs = 0
Fv = 0.0025
Jcomp = 0.0227
Jengine = 0.22
Ki = 251.3274
Kisa = 346.6583
Kp_d = 0.47149
Kp_q = 0.52125
Ksa = 85.4316
Ksf = 1996.2651
Ld = 0.0003752
Ldq = [0.0003752 0.0004148]
Lq = 0.0004148
Mechanical = [0.0227 0.0025 0]
MotGbRatio = 1
P = 4
PolePairs = 4
RWheel = 0.3
Rs = 0.2
T_max = 120
T_mtpa = [0 13.31318 26.62788 39.94562 53.26789 66.59622 79.93211 93.27704 106.6325 120]
b_axle = Simulink.Parameter(10)
b_driveshaft = Simulink.Parameter(10)
ba = 3.4029
id_mtpa = [-0 -0.1145234 -0.4579891 -1.030085 -1.830291 -2.857884 -4.111939 -5.591333 -7.294754 -9.2207]
idq0 = [0 0]
idq_limits = [-9.2207 166.9935 167.2479]
iq_mtpa = [0 18.58274 37.16337 55.73977 74.30985 92.87152 111.4227 129.9615 148.4857 166.9935]
k_axle = Simulink.Parameter(5000)
k_driveshaft = Simulink.Parameter(1000)
lambda_pm = 0.1194
mechanical = [0.0227 0.0025 0]
omega_init = 0
theta_init = 0
wc_shaft = Simulink.Parameter(0.1)