% Simulink data dictionary Motor_MapMdl_Ptbs_V1.sldd

mot = struct(
  max_trq=307,
  max_pwr=124,
  spd=[0 500 1000 1500 2000 2500 3000 3500 3857.045 4000 4500 5000 5500 6000 6500 7000 7500 8000 8500 9000 9500 10000 10500 11000 11500 12000 12500],
  trq=[307 307 307 307 307 307 307 307 307 296.0282 263.1362 236.8226 215.2932 197.3521 182.1712 169.159 157.8817 148.0141 139.3074 131.5681 124.6435 118.4113 112.7726 107.6466 102.9663 98.67606 94.72902],
  trq_cp=[296.0282 263.1362 236.8226 215.2932 197.3521 182.1712 169.159 157.8817 148.0141 139.3074 131.5681 124.6435 118.4113 112.7726 107.6466 102.9663 98.67606 94.72902],
  J=0.02,
  damp=0.0001,
  Tc=0.0267,
  map=struct(
    spdindex=[0 1000 2000 3000 3857 4000 5000 6000 7000 8000 9000 10000 11000 12000 12584],
    trqindex=[10 25 50 75 100 125 150 175 200 225 250 275 300 307],
    eff=[84 90 90 90 90 90 90 90 90 90 90 90 90 90 90
     84 90 93 95 95 95 96 95 95 95 95 93 93 93 93
     84 90 93 95 95 95 96 95 96 95 95 95 95 93 93
     84 90 93 95 95 95 96 96 96 95 95 95 95 93 93
     84 90 93 95 95 95 96 96 96 95 95 93 93 93 90
     84 88 90 93 93 95 95 96 95 95 95 93 93 93 90
     84 88 90 90 90 93 95 95 95 93 93 93 93 93 90
     84 88 90 90 90 90 93 93 93 93 93 93 93 93 90
     84 84 88 90 90 90 93 93 93 93 93 93 93 93 90
     84 84 88 90 90 90 90 93 93 93 93 93 93 93 90
     84 84 84 90 90 90 90 93 93 93 93 93 93 93 90
     84 84 84 88 90 90 90 93 93 93 93 93 93 93 90
     84 84 84 88 88 88 90 93 93 93 93 93 93 93 90
     84 84 84 88 88 88 90 93 93 93 93 93 93 93 90]),
  m=30,
  Cp=200)